# Grasshopper definition procedural landscape.gh (Grasshopper 1.0.7)

slider = Slider(0, range=-10..0)
slider_2 = Slider(0, range=-10..0)
slider_3 = Slider(100, range=0..100)
slider_4 = Slider(300, range=0..300)
slider_5 = Slider(100, range=0..100)
slider_6 = Slider(271, range=0..300)
crv = Curve([<curve referenced from the Rhino model> x2])
crv_2 = Curve(<curve referenced from the Rhino model>)
building = Mesh(<mesh referenced from the Rhino model>)
# more details
# documented
# in code
mesh_grid_function = CSharpScript(water=crv_2, roads=crv, x0=slider_2, x1=slider_3, nx=slider_6, y0=slider, y1=slider_5, ny=slider_4, b=building)  # -> out, mesh, watermesh, road0mesh, road1mesh, plants, noplants; inputs water: Curve, roads: list of Curve, x0: Double, x1: Double, nx: Int32, y0: Double, y1: Double, ny: Int32, b: Mesh
# ---------- mesh_grid_function: C# usings ----------
using System.IO;
using System.Linq;
using System.Data;
using System.Drawing;
using System.Reflection;
using System.Windows.Forms;
using System.Xml;
using System.Xml.Linq;
using System.Runtime.InteropServices;

using Rhino.DocObjects;
using Rhino.Collections;
using GH_IO;
using GH_IO.Serialization;
# ---------- mesh_grid_function: C# ----------
    //create a grid of points and add them as vertices in the mesh
    //then add faces to the mesh for each quad in the grid


    //calculate grid step for resolutions nx and ny along the x and y axes respectively
    double length = x1 - x0;
    double width = y1 - y0;
    double dx = length / (double) (nx - 1.0);
    double dy = width / (double) (ny - 1.0);


    //list of points to create base topography
    List<Point3d> topo = new List<Point3d>();

    //list holding pts to create mesh for water
    List<Point3d> waterpts = new List<Point3d>();

    //list of points to create road0 mesh
    List<Point3d> road0pts = new List<Point3d>();
    //list of points to create road1 mesh
    List<Point3d> road1pts = new List<Point3d>();

    //generate the surface points and add them to the mesh
    for(int j = 0; j < ny; ++j) {
      for(int i = 0; i < nx; ++i) {
        double x = x0 + i * dx;
        double y = y0 + j * dy;

        //create point on flat plane:
        Point3d gridP = new Point3d(x, y, 0.0);

        //blending for ground (occurs along x=y)
        double t = (( x - x0) / length + (y - y0) / width) / 2;
        t = t * t;
        //topography behaves more and more like 0.3*y with increasing x
        //double z0 = 0.25 * Math.Cos(x / 2) * Math.Sin(y / 2);
        double z0 = 10 * Math.Cos(0.01 * x) * Math.Sin(0.1 * y);
        double z1 = (y) *0.3;
        double z = z0 * (1.0 - t) + z1 * t;

        //water: depth given as sin funtion w/r to length along water, width 4 (3N+1S)
        //d_to_waterorigin is distance from (starting pt of water) to (pt on water closest to gridP)
        double d_to_waterorigin;
        water.ClosestPoint(gridP, out d_to_waterorigin);
        Point3d cp = water.PointAt(d_to_waterorigin);
        double d_water = gridP.DistanceTo(cp); //distance from cp to gridP


        //d_to_waterorigin unitized to express percentage along water
        d_to_waterorigin = d_to_waterorigin / water.GetLength();
        //water depth given as a function (based on pt to along water to origin)
        double depth = 5 * d_to_waterorigin * Math.Sin(10 * d_to_waterorigin + 50) + 4;
        bool in_water = gridP.Y > cp.Y && d_water < 3 || gridP.Y < cp.Y && d_water < 1; //North side of water, wider




        //North side of water, wider
        if (gridP.Y > cp.Y && d_water < 3) {
          z = z - (9 - d_water * d_water) / 9 * Math.Abs(depth); //depth decreases towards river banks
          waterpts.Add(new Point3d(x, y, z));
        }
          //South side of water, narrower
        else if (gridP.Y < cp.Y && d_water < 1) {
          z = z - (1 - d_water * d_water) * Math.Abs(depth);
          waterpts.Add(new Point3d(x, y, z));
        }
        else{
          //road0: width 10(5+5)
          double d_to_road0 = 0.0;
          roads[0].ClosestPoint(gridP, out d_to_road0);
          Point3d cp_road0 = roads[0].PointAt(d_to_road0);
          double d_road0 = gridP.DistanceTo(cp_road0);
          bool in_r0 = d_road0 < 5;

          //road1: width 10 (5+5)
          double d_to_road1 = 0.0;
          roads[1].ClosestPoint(gridP, out d_to_road1);
          Point3d cp_road1 = roads[1].PointAt(d_to_road1);
          double d_road1 = gridP.DistanceTo(cp_road1);

          //took off curvyness given by z0, same z for given point along road curve
          //road0
          if (d_road0 < 5) {
            double z0_r0 = 10 * Math.Cos(0.01 * cp_road0.X) * Math.Sin(0.1 * cp_road0.Y);
            double z1_r0 = 0.3 * cp_road0.Y;
            double t_r0 = (( cp_road0.X - x0) / length + (cp_road0.Y - y0) / width) / 2;
            t_r0 = t_r0 * t_r0;
            z = z1_r0 * t_r0 + z0_r0 * (1 - t_r0) + 0.5;
            road0pts.Add(new Point3d(x, y, z));
          }
            //road1 (shorter, blends into r1)
          else if (d_road1 < 5) {
            double z0_r1 = 10 * Math.Cos(0.01 * cp_road1.X) * Math.Sin(0.1 * cp_road1.Y);
            double z1_r1 = 0.3 * cp_road1.Y;
            double t_r1 = ((cp_road1.X - x0) / length + (cp_road1.Y - y0) / width) / 2;
            t_r1 = t_r1 * t_r1;
            z = z1_r1 * t_r1 + z0_r1 * (1 - t_r1) + 0.5;
            road1pts.Add(new Point3d(x, y, z));
          }
          else{
            //create base mesh for topography (including dip for water, but not extrusions for roads
            Point3d test_pt = new Point3d(x, y, z);
            double bMaxZ = maxZ(b);
            if (b.IsPointInside(test_pt, 0.1, false)) {z = bMaxZ;
            }else{
              double dist_to_b = Dist(test_pt, b);
              if (dist_to_b < 25){
                //double t2 = Math.Sqrt(dist_to_b / 25);
                //double t3 = (Math.Atan((25-dist_to_b) *0.4-7) + Math.PI / 2)/Math.PI;
                //z = t2 * test_pt.Z + (1 - t2) * bMaxZ;

                double t3 = 1 / (1 + Math.Pow((dist_to_b / 5.0), 2.0));
                //uses a secondary function to reach 0
                if (dist_to_b > 15){t3 = (25 - dist_to_b) / 100;}

                z = (1 - t3) * test_pt.Z + t3 * bMaxZ;
              }
            }
          }

        }
        Point3d topo_pt = new Point3d(x, y, z);
        topo.Add(topo_pt);
      }
    }

    //create meshed for water and roads
    Mesh twatermesh = Mesh.CreateFromTessellation(waterpts, null, Plane.WorldXY, false);
    Mesh troad0mesh = Mesh.CreateFromTessellation(road0pts, null, Plane.WorldXY, false);
    Mesh troad1mesh = Mesh.CreateFromTessellation(road1pts, null, Plane.WorldXY, false);

    //cull out triangles that are not connected correctedly (method CullBadTri defined below)
    List<int> badtri_water = new List<int>();
    CullBadtri(badtri_water, twatermesh);
    List<int> badtri_road0 = new List<int>();
    CullBadtri(badtri_road0, troad0mesh);
    List<int> badtri_road1 = new List<int>();
    CullBadtri(badtri_road1, troad1mesh);

    //create meshed for topography
    Mesh topomesh = Mesh.CreateFromTessellation(topo, null, Plane.WorldXY, false);
    topomesh.Normals.ComputeNormals(); //update the normals of the mesh so that it displays with correct lighting in the viewport


    //extract roads and water from topography mesh to define plantable area
    Mesh plantable = (Mesh) topomesh.Duplicate();
    List<int> extract = new List<int>(); //list of points that need to be extracted

    for (int i = 0; i < plantable.Faces.Count; i++){

      Point3d p1 = plantable.Vertices[plantable.Faces[i].A];
      Point3d p2 = plantable.Vertices[plantable.Faces[i].B];
      Point3d p3 = plantable.Vertices[plantable.Faces[i].C];

      Point3d centroid = (p1 + p2 + p3) / 3;
      Point3d centroidFlat = new Point3d (centroid.X, centroid.Y, 0);

      double d_to_waterorigin;
      water.ClosestPoint(centroidFlat, out d_to_waterorigin);
      Point3d cp = water.PointAt(d_to_waterorigin);
      double d_water = centroidFlat.DistanceTo(cp); //distance from cp to gridP

      bool waterN = centroidFlat.Y > cp.Y && d_water < 3.5;
      bool waterS = centroidFlat.Y < cp.Y && d_water < 1.5;

      if (waterN || waterS || Dist(centroidFlat, roads[0]) < 5.5 || Dist(centroidFlat, roads[1]) < 5.5){extract.Add(i);}
    }
    Mesh unplantable = plantable.Faces.ExtractFaces(extract);

    topomesh.Normals.ComputeNormals();
    twatermesh.Normals.ComputeNormals();
    troad0mesh.Normals.ComputeNormals();
    troad1mesh.Normals.ComputeNormals();
    plantable.Normals.ComputeNormals();
    //unplantable.Normals.ComputeNormals();
    //outputs
    mesh = topomesh;
    watermesh = twatermesh;
    road0mesh = troad0mesh;
    road1mesh = troad1mesh;
    plants = plantable;//excludes water + roads, with 0.5 buffer
    noplants = unplantable; //water + roads, with 0.5 buffer
# ---------- mesh_grid_function: C# additional code ----------
  int gray(double t) {
    int g = (int) (t * 255.0);
    if (g < 0) g = 0;
    else if (g > 255) g = 255;
    return g;
  }

  double Dist(Point3d p, Curve c0) {
    double t = 0.0;
    c0.ClosestPoint(p, out t);
    Point3d cp = c0.PointAt(t);
    return p.DistanceTo(cp);
  }

  Point3d ClosestPt(Point3d p, Curve c0) {
    double t = 0.0;
    c0.ClosestPoint(p, out t);
    Point3d cp = c0.PointAt(t);
    return cp;
  }

  double Dist(Point3d p, Point3d p0) {
    return p.DistanceTo(p0);
  }

  double Dist(Point3d p, Mesh m0) {
    Point3d cp = m0.ClosestPoint(p);
    return p.DistanceTo(cp);
  }

  double maxZ(Mesh m){
    double maxZ = Double.MinValue;
    foreach (Point3d p in m.Vertices){
      if (p.Z > maxZ) maxZ = p.Z;
    }
    return maxZ;
  }

  void CullBadtri(List < int> badtri, Mesh m){
    for (int i = 0; i < m.Faces.Count; i++){
      Point3d p1 = m.Vertices[m.Faces[i].A];
      Point3d p2 = m.Vertices[m.Faces[i].B];
      Point3d p3 = m.Vertices[m.Faces[i].C];

      double d1 = Dist(p1, p2);
      double d2 = Dist(p1, p3);
      double d3 = Dist(p2, p3);

      if (d1 > 10 || d2 > 10 || d3 > 10) {
        badtri.Add(i);
      }
    }
    m.Faces.ExtractFaces(badtri);
  }
# ---------- end mesh_grid_function ----------
base_mesh = CSharpScript(x0=slider_2, x1=slider_3, nx=slider_6, y0=slider, y1=slider_5, ny=slider_4)  # -> out, mesh; inputs x0: Double, x1: Double, nx: Int32, y0: Double, y1: Double, ny: Int32; disabled
# ---------- base_mesh: C# ----------
    //create a grid of points and add them as vertices in the mesh
    //then add faces to the mesh for each quad in the grid

    //list of points to hold topography
    List<Point3d> topo = new List<Point3d>();

    //calculate grid step for resolutions nx and ny along the x and y axes respectively
    double length = x1 - x0;
    double width = y1 - y0;
    double dx = length / (double) (nx - 1.0);
    double dy = width / (double) (ny - 1.0);


    //generate the surface points and add them to the mesh
    for(int j = 0; j < ny; ++j) {
      for(int i = 0; i < nx; ++i) {
        double x = x0 + i * dx;
        double y = y0 + j * dy;

        //create point on flat plane:
        Point3d gridP = new Point3d(x, y, 0.0);

        //blending for ground (occurs along x=y)
        double t = (( x - x0) / length + (y - y0) / width) / 2;
        t = t * t;
        //topography behaves more and more like 0.3*y with increasing x
        double z0 = 10 * Math.Cos(0.01 * x) * Math.Sin(0.1 * y);
        double z1 = (y) *0.3;
        double z = z0 * (1.0 - t) + z1 * t;

        Point3d topo_pt = new Point3d(x, y, z);
        topo.Add(topo_pt);
      }
    }

    //create meshed for topography
    Mesh topomesh = Mesh.CreateFromTessellation(topo, null, Plane.WorldXY, false);
    topomesh.Normals.ComputeNormals(); //update the normals of the mesh so that it displays with correct lighting in the viewport

    //outputs
    mesh = topomesh;
# ---------- base_mesh: C# additional code ----------
  int gray(double t) {
    int g = (int) (t * 255.0);
    if (g < 0) g = 0;
    else if (g > 255) g = 255;
    return g;
  }

  double Dist(Point3d p, Curve c0) {
    double t = 0.0;
    c0.ClosestPoint(p, out t);
    Point3d cp = c0.PointAt(t);
    return p.DistanceTo(cp);
  }

  Point3d ClosestPt(Point3d p, Curve c0) {
    double t = 0.0;
    c0.ClosestPoint(p, out t);
    Point3d cp = c0.PointAt(t);
    return cp;
  }

  double Dist(Point3d p, Point3d p0) {
    return p.DistanceTo(p0);
  }

  double Dist(Point3d p, Mesh m0) {
    Point3d cp = m0.ClosestPoint(p);
    return p.DistanceTo(cp);
  }

  double maxZ(Mesh m){
    double maxZ = Double.MinValue;
    foreach (Point3d p in m.Vertices){
      if (p.Z > maxZ) maxZ = p.Z;
    }
    return maxZ;
  }

  void CullBadtri(List < int> badtri, Mesh m){
    for (int i = 0; i < m.Faces.Count; i++){
      Point3d p1 = m.Vertices[m.Faces[i].A];
      Point3d p2 = m.Vertices[m.Faces[i].B];
      Point3d p3 = m.Vertices[m.Faces[i].C];

      double d1 = Dist(p1, p2);
      double d2 = Dist(p1, p3);
      double d3 = Dist(p2, p3);

      if (d1 > 10 || d2 > 10 || d3 > 10) {
        badtri.Add(i);
      }

    }

    m.Faces.ExtractFaces(badtri);
  }
# ---------- end base_mesh ----------
mesh = Mesh(mesh_grid_function.road0mesh)
mesh_2 = Mesh(mesh_grid_function.noplants)
mesh_3 = Mesh(mesh_grid_function.watermesh)
mesh_4 = Mesh(mesh_grid_function.mesh)
mesh_5 = Mesh(mesh_grid_function.road1mesh)
elevation = CSharpScript(m=mesh_grid_function.mesh)  # -> out, A; inputs m: Mesh; disabled
# ---------- elevation: C# ----------
    //here we color the vertices of the mesh according to their Z coordinate

    for(int i = 0; i < m.Vertices.Count; ++i) {
      Point3d vx = m.Vertices[i]; //extract vertex i

      //parametricize values and use RGB
      double hue = vx.Z * 0.02;//how should this value be determined?
      Rhino.Display.ColorHSL c = new Rhino.Display.ColorHSL(hue, 1.0, 0.8); //this is a special utility class in rhino that helps express color in HSL rather than RGB color space
      m.VertexColors.SetColor(i, c.ToArgbColor());
    }


    A = m;
# ---------- end elevation ----------
normal_color = CSharpScript(m=mesh_grid_function.mesh)  # -> out, A; inputs m: Mesh; disabled
# ---------- normal_color: C# ----------
    //this example generates RGB colors for each vertex proportional
    //to the absolute values of theyr corresponding normals
    //the effect is that areas of the surface that point up (+Z) or down (-Z)
    //will be colored blue, areas along the Y axis green and along the X axis red
    //it is the same result that you would get if you had 6 spotlights (2 red, 2 green and two blue)
    //and placed them around your geometry with the blue ones far above and below
    //and the other 4 to the sides along the X and Y axes

    for(int i = 0; i < m.Vertices.Count; ++i) {
      Point3d vx = m.Vertices[i];
      Vector3d n = m.Normals[i];


      int red = colorComponent(Math.Abs(n.X));
      int green = colorComponent(Math.Abs(n.Y));
      int blue = colorComponent(Math.Abs(n.Z));

      m.VertexColors.SetColor(i, red, green, blue);
    }


    A = m;
# ---------- normal_color: C# additional code ----------
  //utility function that generates an integer number between 0-255 for a double number between 0.0 and 1.0
  //it makes sure to clamp the values so they don't exist the 0-255 range which is valid for color components
  int colorComponent(double cc) {
    int ci = (int) (cc * 255.0);
    if (ci < 0) return 0;
    if (ci > 255) return 255;
    return ci;
  }
# ---------- end normal_color ----------
slope = CSharpScript(m=mesh_grid_function.mesh)  # -> out, A; inputs m: Mesh; disabled
# ---------- slope: C# ----------
    for(int i = 0; i < m.Vertices.Count; ++i) {
      Point3d vx = m.Vertices[i];
      Vector3d n = m.Normals[i];

      double slopeCosine = n.Z;
      double slopeAngle = Math.Acos(slopeCosine);

      int gray = colorComponent(slopeAngle / (Math.PI * 0.5));

      m.VertexColors.SetColor(i, gray, gray, gray);
    }


    A = m;
# ---------- slope: C# additional code ----------
  //utility function that generates an integer number between 0-255 for a double number between 0.0 and 1.0
  //it makes sure to clamp the values so they don't exist the 0-255 range which is valid for color components
  int colorComponent(double cc) {
    int ci = (int) (cc * 255.0);
    if (ci < 0) return 0;
    if (ci > 255) return 255;
    return ci;
  }
# ---------- end slope ----------
mesh_partition = CSharpScript(m=mesh_grid_function.plants)  # -> out, A, B; inputs m: Mesh
# ---------- mesh_partition: C# ----------
    //this will be the list of face indices
    //that will be isolated from the mesh
    List<int> facesA = new List<int>();

    //ensure the mesh has Face normals
    m.FaceNormals.ComputeFaceNormals();


    for(int i = 0; i < m.Faces.Count; ++i) {
      //get the center and normal of each face [i]
      Point3d fcen = m.Faces.GetFaceCenter(i);
      Vector3d fn = m.FaceNormals[i];

      //if the normal is facing towards the negative Y (south) then add the corresponding face index
      //to the list to be extracted
      if (fn.Y < 0.0) facesA.Add(i);

    }

    //decompose the mesh by extracting all the faces we stored in the list
    Mesh m1 = m.Faces.ExtractFaces(facesA);

    A = m1;
    B = m;
# ---------- end mesh_partition ----------
custom_preview = CustomPreview(Geometry=mesh_partition.A, PlantableMoreSun=ColourSwatch(SwatchColor=RGB(69, 177, 102)))
custom_preview_2 = CustomPreview(Geometry=mesh_partition.B, PlantableLessSun=ColourSwatch(SwatchColor=RGB(151, 255, 125)))
custom_preview_3 = CustomPreview(Geometry=building, Material=ColourSwatch(SwatchColor=RGB(184, 184, 184)))
custom_preview_4 = CustomPreview(
    Geometry=[mesh_grid_function.noplants, mesh_grid_function.road1mesh, mesh_grid_function.road0mesh],
    Material=ColourSwatch(SwatchColor=RGB(156, 156, 156)))
custom_preview_5 = CustomPreview(Geometry=mesh_grid_function.watermesh, Material=ColourSwatch(SwatchColor=RGBA(0, 72, 255, 169)))
geometry = Geometry(<mesh referenced from the Rhino model>)
geometry_2 = Geometry(<brep referenced from the Rhino model>)
grass_trees = CSharpScript(m=mesh_partition.A, grass=geometry_2)  # -> out, n, point, trees, trunks, grasses; inputs m: Mesh, grass: Mesh
# ---------- grass_trees: C# ----------
    //this will be the list of face indices
    //that will be isolated from the mesh
    List<int> facesA = new List<int>();
    List<int> facesB = new List<int>();
    List<Vector3d> ns = new List<Vector3d>();
    List<Point3d> pts = new List<Point3d>();

    //ensure the mesh has Face normals
    m.FaceNormals.ComputeFaceNormals();


    for(int i = 0; i < m.Faces.Count; ++i) {
      //get the center and normal of each face [i]
      Point3d fcen = m.Faces.GetFaceCenter(i);
      Vector3d fn = m.FaceNormals[i];

      if (fn.Z > 0.5){
        ns.Add(fn);
        pts.Add(fcen);
      }

    }

    List<Brep> tree = new List<Brep>();
    List<Brep> trunk = new List<Brep>();
    List<GeometryBase> grasslist = new List<GeometryBase>();

    BoundingBox box_g = grass.GetBoundingBox(true);
    Point3d root_g = new Point3d(box_g.Center.X, box_g.Center.Y, box_g.Center.Z - 0.1);
    Plane grassPlane = new Plane(root_g, Vector3d.ZAxis);

    int iterator = pts.Count / 50;
    int remainder = pts.Count % 50;
    for (int i = 0; i < pts.Count-remainder; i += iterator){
      Point3d p = pts[i];
      Point3d p_tree = new Point3d(p.X, p.Y, (p.Z + p.Z / 5 + 1.5));
      Rhino.Geometry.Sphere s = new Rhino.Geometry.Sphere(p_tree, (p.Z / 10 + 1) * ns[i].Z);
      tree.Add(s.ToBrep());

      Rhino.Geometry.Circle c = new Rhino.Geometry.Circle(p_tree, p.Z / 70 + 0.1);
      Rhino.Geometry.Cylinder cy = new Rhino.Geometry.Cylinder(c, -p.Z / 5 - 2);
      trunk.Add(cy.ToBrep(true, true));
      
      for (int j = 1;j < iterator; j += 5){
        int k = i + j;
        double sFactor = 10 + pts[k].Z / 200;
        Transform S = Transform.Scale(box_g.Center, sFactor);

        Plane tPlane = new Plane(pts[k], ns[i]);
        Transform TR = Transform.PlaneToPlane(grassPlane, tPlane);

        GeometryBase grass2 = grass.Duplicate();
        grass2.Transform(TR * S);
        grasslist.Add(grass2);
      }
    }
    


    n = ns;
    point = pts;
    trees = tree;
    trunks = trunk;
    grasses = grasslist;
# ---------- end grass_trees ----------
grass_shrubs = CSharpScript(bush=geometry, grass=geometry_2, m=mesh_partition.B)  # -> out, bushes, bushroots, grasses, grassroots; inputs bush: GeometryBase, grass: Mesh, m: Mesh
# ---------- grass_shrubs: C# ----------
    List<Vector3d> nsA = new List<Vector3d>();
    List<Point3d> ptsA = new List<Point3d>();

    //ensure the mesh has Face normals
    m.FaceNormals.ComputeFaceNormals();

    //gets all pts and normals of mesh
    for(int i = 0; i < m.Faces.Count; ++i) {
      //get the center and normal of each face [i]
      Point3d fcen = m.Faces.GetFaceCenter(i);
      Vector3d fn = m.FaceNormals[i];

      if (fn.Z > 0.7){
        nsA.Add(fn);
        ptsA.Add(fcen);
      }
    }

    List<Vector3d> ns_bush = new List<Vector3d>();
    List<Point3d> pts_bush = new List<Point3d>();
    List<Vector3d> ns_grass = new List<Vector3d>();
    List<Point3d> pts_grass = new List<Point3d>();


    //gets 30 pts and their normals to create bushes
    int iterator = ptsA.Count / 30;
    int remainder = ptsA.Count % 30;
    for (int i = 0; i < ptsA.Count - remainder; i += iterator){
      pts_bush.Add(ptsA[i]);
      ns_bush.Add(nsA[i]);

      for (int j = 1; j < iterator; j = j + 50){
        int k = i + j;
        //Point3d a = new Point3d(0, 0,);
        if (ptsA[k].DistanceTo(ptsA[i]) > 5){
          pts_grass.Add(ptsA[k]);
          ns_grass.Add(nsA[k]);
        }

      }
    }

    List<GeometryBase> bushlist = new List<GeometryBase>();

    BoundingBox box_bush = bush.GetBoundingBox(true);
    Point3d root_bush = new Point3d(box_bush.Center.X, box_bush.Center.Y, box_bush.Center.Z - 0.75);


    for(int i = 0; i < pts_bush.Count; ++i) {
      Vector3d toPoint = pts_bush[i] - box_bush.Center;
      Transform T = Transform.Translation(toPoint);
      double sFactor = 0.3 + pts_bush[i].Z / 50;
      Transform S = Transform.Scale(box_bush.Center, sFactor);

      GeometryBase bush2 = bush.Duplicate();

      Plane bushPlane = new Plane(root_bush, Vector3d.ZAxis);
      Plane tPlane = new Plane(pts_bush[i], ns_bush[i]);
      Transform TR = Transform.PlaneToPlane(bushPlane, tPlane);

      bush2.Transform(TR * S);
      bushlist.Add(bush2);
    }

    List<GeometryBase> grasslist = new List<GeometryBase>();

    BoundingBox box_g = grass.GetBoundingBox(true);
    Point3d root_g = new Point3d(box_g.Center.X, box_g.Center.Y, box_g.Center.Z - 0.1);
    Plane grassPlane = new Plane(root_g, Vector3d.ZAxis);

    for(int i = 0; i < pts_grass.Count; ++i) {
      double sFactor = 10 + pts_grass[i].Z / 200;
      Transform S = Transform.Scale(box_g.Center, sFactor);

      Plane tPlane = new Plane(pts_grass[i], ns_grass[i]);
      Transform TR = Transform.PlaneToPlane(grassPlane, tPlane);

      GeometryBase grass2 = grass.Duplicate();
      grass2.Transform(TR * S);
      grasslist.Add(grass2);
    }

    bushes = bushlist;
    bushroots = pts_bush;
    grasses = grasslist;
    grassroots = pts_grass;
# ---------- end grass_shrubs ----------
mesh_6 = Mesh(grass_trees.grasses)
# view in "rendered view" in Rhino
colour_swatch = ColourSwatch(SwatchColor=RGBA(28, 94, 34, 155))
mesh_7 = Mesh(grass_shrubs.grasses)
pt = Point(grass_shrubs.grassroots)
mesh_8 = Mesh(grass_shrubs.bushes)
custom_preview_6 = CustomPreview(Geometry=grass_trees.trunks, Material=ColourSwatch(SwatchColor=RGB(135, 91, 24)))
custom_preview_7 = CustomPreview(Geometry=grass_trees.trees, Material=colour_swatch)
custom_preview_8 = CustomPreview(Geometry=grass_shrubs.bushes, Material=ColourSwatch(SwatchColor=RGBA(53, 171, 63, 207)))
